# Grasshopper definition npFEM_RhinoGH.gh (Grasshopper 0.9.76)
# plug-ins: Python Interpreter

# ---- group: Load Mesh
list = ValueList({"RBC_Surface_mesh_258SurfVer": "Case Studies\RBC_Surface_mesh_258SurfVer.3dm", "PLT_Larger_Surface_mesh_66SurfVer": "Case Studies\PLT_Larger_Surface_mesh_66SurfVer.3dm"}, selected="RBC_Surface_mesh_258SurfVer")
_3dm = Import3DM(File=list, Layer="*", Name="*")
weld = WeldMesh(Mesh=_3dm, Angle=3.141592654)
mesh = Mesh(weld)

# ---- group: Prepare points to apply stretching force
percentage = Slider(0.05, range=0.01..0.3)
percentage_2 = Slider(0.05, range=0.01..0.3)
mesh_2 = Mesh(mesh)
stretching_force_pn = Slider(200, range=0..200000)
python = PythonScript(Mesh=mesh_2, perc_r=percentage, perc_l=percentage_2)  # -> Pt_x_plus, Pt_x_minus; inputs Mesh: Mesh
# ---------- python: Python ----------
import ghpythonlib.components as ghcomp
import Rhino as rc
import Grasshopper as gh

Pt_x_plus = []
Pt_x_minus = []

# Make mesh vertices point search list
ptsList = rc.Collections.Point3dList(Mesh.Vertices.ToPoint3dArray())

# Sort Points by x, y , z (keep the indices)
sorted_inds = ghcomp.SortPoints(ptsList)[1]

# Number of Pts to pick from each side
num_pts_r = int(perc_r*len(ptsList))
num_pts_l = int(perc_l*len(ptsList))

for i in sorted_inds[-num_pts_r:]:
    Pt_x_plus.append(ptsList[i])
for i in sorted_inds[:num_pts_l]:
    Pt_x_minus.append(ptsList[i])
# ---------- end python ----------
soai = ShapeOpAnchorsIndexer(Mesh=mesh_2, AnchorGeo=python.Pt_x_plus)  # -> flatten(PointIndices), AnchorPts; inputs Mesh: Mesh, AnchorGeo: list
# ---------- soai: Python ----------
"""
Gets the vertex indices of the mesh which corresponds to the points of the AnchorGeo.
If the AnchorGeo is a curve/polyline/line its start-point will be used to identify 
which mesh vertex should be anchored and its end-point will be used to determine
which point to anchor the vertex to. If the AnchorGeo is point this will be used
as both identifier and anchor point. Use curve-types to interactively manipulate
anchoring positions and points for static positions.
-
Authors: Anders Holden Deleuran (CITA/KADK), Mario Deuss (LGG/EPFL) 
Github: github.com/AndersDeleuran/ShapeOpGHPython
Updated: 150401
    Args:
        Mesh: The mesh to extract vertex indices from.
        AnchorGeo: Geometry to use for anchoring mesh vertices (points or curve-type).
    Returns:
        PointIndices: The mesh with vertices to anchor.
        AnchorPts: The anchor points.
"""

import Rhino as rc
import Grasshopper as gh

# Set component name
ghenv.Component.Name = "ShapeOpAnchorsIndexer"
ghenv.Component.NickName = "SOAI"

if AnchorGeo and Mesh and not None in AnchorGeo:
    
    # Make output datatrees
    PointIndices = gh.DataTree[int]()
    AnchorPts = gh.DataTree[rc.Geometry.Point3d]()
    
    # Make mesh vertices point search list
    ptsList = rc.Collections.Point3dList(Mesh.Vertices.ToPoint3dArray())
    
    for i,ag in enumerate(AnchorGeo):
        
        # Make datatree path
        p = gh.Kernel.Data.GH_Path(i)
        
        # Get anchor start and end points
        if isinstance(ag,rc.Geometry.Curve):
            aPtS = ag.PointAtStart
            aPtE = ag.PointAtEnd
        elif isinstance(ag,rc.Geometry.Point3d):
            aPtS = ag
            aPtE = ag
            
        # Get index of points to anchor and add to PointIndices datatree
        aPtId = ptsList.ClosestIndex(aPtS)
        PointIndices.AddRange((aPtId,),p)
        
        # Add anchor end points to datatree
        AnchorPts.Add(aPtE,p)
        
else:
    PointIndices = []
    AnchorPts = []
# ---------- end soai ----------
soai_2 = ShapeOpAnchorsIndexer(Mesh=mesh_2, AnchorGeo=python.Pt_x_minus)  # -> flatten(PointIndices), AnchorPts; inputs Mesh: Mesh, AnchorGeo: list; same code as soai
neg = Negative(Value=stretching_force_pn)
X = UnitX(Factor=stretching_force_pn)
X_2 = UnitX(Factor=neg)

# ----
demesh = DeconstructMesh(Mesh=mesh)  # -> Vertices, Faces, Colours, Normals

# ---- group: Prepare Material for FEM solver
mesh_3 = Mesh(mesh)

list_2 = ValueList({"FaceVertices": "faceVertices", "VertexNeighbours": "vertexNeighbours", "EdgeVertices": "edgeVertices", "VerticesAll": "verticesAll", "VerticesEach": "verticesEach", "EdgeFaceVertices": "edgeFaceVertices", "FaceAngleVertices": "faceAngleVertices", "NakedVertices": "nakedVertices"}, selected="FaceVertices")
rangemax = Slider(1, range=1..10)
lambda = Slider(5, range=0..50000)
kappa = Slider(0, range=0..1000)
miu = Slider(35, range=0..1000)
rangemin = Slider(1, range=0..1)
list_3 = ValueList({"SurfaceMaterial", "EdgeStrain", "TriangleStrain", "TetrahedronStrain", "Area", "Volume", "Bending", "Closeness", "Line", "Plane", "Circle", "Sphere", "Similarity", "Rigid", "Rectangle", "Parallelogram", "Laplacian", "LaplacianDisplacement", "Angle"}, selected="SurfaceMaterial")
somi = ShapeOpMeshIndexer(Pattern=list_2, Mesh=mesh_3)  # -> PointIndices; inputs Mesh: Mesh
# ---------- somi: Python ----------
"""
Extract vertex indices from a mesh using various patterns.
-
Authors: Anders Holden Deleuran (CITA/KADK), Mario Deuss (LGG/EPFL) 
Github: github.com/AndersDeleuran/ShapeOpGHPython
Updated: 150401
    Args:
        Pattern:
            The vertex indices pattern to extract from the mesh:
                -
                faceVertices = vertex indices for each face.
                vertexNeighbours = neighbour vertex indices for each vertex.
                edgeVertices = vertex indices for each edge.
                verticesAll = vertex indices for each vertex (flat list).
                verticesEach = vertex indices for each vertex (datatree).
                edgeFaceVertices = neighbour face-vertex indices for each edge (use for bending).
                faceAngleVertices = neighbour vertices for each vertex corner for each face.
                nakedVertices = vertices on the perimeter of the mesh, sorted by closed loops.
        Mesh: The mesh to extract vertex indices from.
    Returns:
        PointIndices: The vertex indices pattern.
"""

import Grasshopper as gh

# Set component name
ghenv.Component.Name = "ShapeOpMeshIndexer"
ghenv.Component.NickName = "SOMI"

def getFaceVertices(mesh):
    
    """ Get datatree with the face vertex indices for each face in a mesh """
    
    faceVertices = gh.DataTree[int]()
    
    for i in range(Mesh.Faces.Count):
        fl = Mesh.Faces.Item[i]
        if fl.IsQuad:
            fIDs = (fl.A,fl.B,fl.C,fl.D)
        else:
            fIDs = (fl.A,fl.B,fl.C)
        faceVertices.AddRange(fIDs,gh.Kernel.Data.GH_Path(i))
        
    return faceVertices

def getVertexNeighbours(mesh):
    
    """ Get datatree with the vertex plus vertex neighbour indices
    for each vertex in a mesh """
    
    vertexNeighbours = gh.DataTree[int]()
    
    for i in range(Mesh.Vertices.Count):
        vnIDs = [i] + list(Mesh.Vertices.GetConnectedVertices(i))
        vertexNeighbours.AddRange(vnIDs,gh.Kernel.Data.GH_Path(i))
        
    return vertexNeighbours

def getEdgeVertices(mesh):
    
    """ Get datatree with the edge vertex indices for each edge in mesh """
    
    # Get edge vertices
    edges = []
    for i in range(Mesh.Vertices.Count):
        neighbours = Mesh.Vertices.GetConnectedVertices(i)
        for n in neighbours:
            if n > i:
                edges.append((i,n))
                
    # Make datatree
    edgeVertices = gh.DataTree[int]()
    for i,e in enumerate(edges):
        edgeVertices.AddRange(e,gh.Kernel.Data.GH_Path(i))
        
    return edgeVertices

def getVerticesEach(mesh):
    
    """ Get datatree with the index of each vertex in a mesh """
    
    verticesEach = gh.DataTree[int]()
    for i in range(Mesh.Vertices.Count):
        verticesEach.AddRange([i],gh.Kernel.Data.GH_Path(i))
        
    return verticesEach

def getVerticesAll(mesh):
    
    """ Get a list with all the vertex indices of a mesh """
    
    verticesAll = range(mesh.Vertices.Count)
    
    return verticesAll

def getEdgeFaceVertices(mesh):
    
    """ Get datatree with the four/six face vertex indices for each mesh edge, 
    which is used to construct the shapeop bending constraint signature """
    
    # Make GH datatree
    edgeFaceVerticesPtIDs = gh.DataTree[int]()
    
    for i in range(mesh.TopologyEdges.Count):
        
        p = gh.Kernel.Data.GH_Path(i)
        
        if len(mesh.TopologyEdges.GetConnectedFaces(i)) == 2:
            
            # Get edge vertex indices
            tVts = mesh.TopologyEdges.GetTopologyVertices(i)
            eVtA = mesh.TopologyVertices.MeshVertexIndices(tVts.I)[0]
            eVtB = mesh.TopologyVertices.MeshVertexIndices(tVts.J)[0]
            eVts = set((eVtA,eVtB))
            
            # Get edge face vertex index
            fA,fB = mesh.TopologyEdges.GetConnectedFaces(i)
            fVtsA = mesh.Faces.GetTopologicalVertices(fA)
            fVtsB = mesh.Faces.GetTopologicalVertices(fB)
            fVtsA = [mesh.TopologyVertices.MeshVertexIndices(i)[0] for i in fVtsA]
            fVtsB = [mesh.TopologyVertices.MeshVertexIndices(i)[0] for i in fVtsB]
            fVts = set(fVtsA + fVtsB)
            
            # Get the face indices which are not part of the edge
            fVts = list(fVts - eVts)
            
            # Make the bending constraint point indices list
            eFVIDs = list(eVts) + fVts
            edgeFaceVerticesPtIDs.AddRange(eFVIDs,p)
            
            
    return edgeFaceVerticesPtIDs

def getFaceAngleVertices(mesh):
    
    """ Get datatree with the face angle vertex indices for each face in a mesh """
    
    faceVertices = gh.DataTree[int]()
    
    n = 0
    for i in range(Mesh.Faces.Count):
        fl = Mesh.Faces.Item[i]
        if fl.IsQuad:
            faceVertices.AddRange((fl.A,fl.B,fl.D),gh.Kernel.Data.GH_Path(n+0))
            faceVertices.AddRange((fl.B,fl.C,fl.A),gh.Kernel.Data.GH_Path(n+1))
            faceVertices.AddRange((fl.C,fl.D,fl.B),gh.Kernel.Data.GH_Path(n+2))
            faceVertices.AddRange((fl.D,fl.A,fl.C),gh.Kernel.Data.GH_Path(n+3))
            n += 4
        else:
            faceVertices.AddRange((fl.A,fl.B,fl.C),gh.Kernel.Data.GH_Path(n+0))
            faceVertices.AddRange((fl.B,fl.C,fl.A),gh.Kernel.Data.GH_Path(n+1))
            faceVertices.AddRange((fl.C,fl.A,fl.B),gh.Kernel.Data.GH_Path(n+2))
            n += 3
            
    return faceVertices

def getNakedVertices(mesh):
    
    """ Get datatree with indices of naked vertices, sorted by closed loops """
    
    # Get naked edges as polylines and naked edge status
    npl = list(mesh.GetNakedEdges())
    nvts = mesh.GetNakedEdgePointStatus()
    
    # Sort the naked vertices by which polyline they belong to
    nakedVertices = gh.DataTree[int]()
    for i,v in enumerate(nvts):
        if v:
            for j,pl in enumerate(npl):
                p = gh.Kernel.Data.GH_Path(j)
                if pl.Contains(mesh.Vertices.Item[i]):
                    nakedVertices.Add(i,p)
                    
    return nakedVertices

if Mesh and Pattern:
    
    if Pattern == "faceVertices":
        PointIndices = getFaceVertices(Mesh)
        
    elif Pattern == "edgeVertices":
        PointIndices = getEdgeVertices(Mesh)
        
    elif Pattern == "vertexNeighbours":
        PointIndices = getVertexNeighbours(Mesh)
        
    elif Pattern == "verticesEach":
        PointIndices = getVerticesEach(Mesh)
        
    elif Pattern == "verticesAll":
        PointIndices = getVerticesAll(Mesh)
        
    elif Pattern == "edgeFaceVertices":
        PointIndices = getEdgeFaceVertices(Mesh)
        
    elif Pattern == "faceAngleVertices":
        PointIndices = getFaceAngleVertices(Mesh)
        
    elif Pattern == "nakedVertices":
        PointIndices = getNakedVertices(Mesh)
else:
    PointIndices = []
# ---------- end somi ----------
merge = Merge(Data1=rangemin, Data2=rangemax, Data3=miu, Data4=lambda, Data5=kappa)
socsig = ShapeOpConstraintSignature(ConstraintType=list_3, PointIndices=somi, Weights=Slider(27.5, range=0..5000), Scalars=merge)  # -> ConstraintSigs; inputs PointIndices: tree of Int32, Weights: list, Scalars: tree
# ---------- socsig: Python ----------
"""
Construct signatures which are used by the ShapeOpConstraintSolver
component to add and edit ShapeOp constraints.
-
Authors: Anders Holden Deleuran (CITA/KADK), Mario Deuss (LGG/EPFL) 
Github: github.com/AndersDeleuran/ShapeOpGHPython
Updated: 150330
    Args:
        ConstraintType:
            A string containing one of the following constraint types (see documentation for more info):
                -
                EdgeStrain = takes 2 indices forming an edge.
                TriangleStrain = takes 3 indices forming a triangle.
                TetrahedronStrain = takes 4 indices forming a tetrahedron.
                Area = takes 3 indices forming a triangle.
                Volume = takes 4 indices forming a tetrahedron.
                Bending = takes 4 indices of two neighboring triangles sharing an edge.
                Closeness = takes 1 index.
                Line = takes 2 or more indices.
                Plane = takes 3 or more indices.
                Circle = takes 3 or more indices.
                Sphere = takes 4 or more indices.
                Similarity = takes 1 or more indices.
                Rigid = takes 1 or more indices.
                Rectangle = takes 4 indices.
                Parallelogram = takes 4 indices.
                Laplacian = takes 2 or more indices, center vertex first, then the one ring neighborhood.
                LaplacianDisplacement = takes 2 or more indices, center vertex first, then the one ring neighborhood.
                AngleConstraint = takes 3 indices forming two consecutive edges.
        PointIndices:
            A datatree of indices of the points subject to the constraints.
        Weights:
            A list of weights of the constraints to be added relative to the other constraints in the ShapeOpSolver (if a single value is provided the same weight will be used).
        Scalars:
            A datatree of floats used to edit certain constraints after they have been created, rangeMin/rangeMax are multipliers (if a single list is provided the same scalars will be used).
                -
                EdgeStrain = The scalars have 3 entries: (1) the desired distance between the two constrained vertices; (2) rangeMin; (3) rangeMax.
                TriangleStrain = The scalars have 2 entries: (1) rangeMin; (2) rangeMax.
                TetrahedronStrain = The scalars have 2 entries: (1) rangeMin; (2) rangeMax.
                Area = The scalars have 2 entries: (1) rangeMin; (2) rangeMax.
                Volume = The scalars have 2 entries: (1) rangeMin; (2) rangeMax.
                Bending = The scalars have 2 entries: (1) rangeMin; (2) rangeMax.
                Closeness = The scalars have 3 entries, which are the desire coordinates of constrained vertex.
                Similarity = The scalars have 3 * n * m entries, where m is the number of candidate shapes that the constrained vertices should be similar to,and n is the number of points in each candidate shape (the same as the number of constrained vertices). Each block of 3 * n scalars provides the point coordinates of a candidate shape.
                Rigid = Same as for "Similarity", see above.
                AngleConstraint =The scalars have 2 entries: (1) minAngle; (2) maxAngle.
    Returns:
        ConstraintSigs: A Python dictionary which wraps all the data for constructing the constraints.
"""

import Rhino as rc

# Set component name
ghenv.Component.Name = "ShapeOpConstraintSignature"
ghenv.Component.NickName = "SOCSig"

if PointIndices.DataCount and ConstraintType and len(Weights):    
    
    # Make dict for storing shapeop constraint signature
    ConstraintSigs = {"type":ConstraintType, "pointIndices":[], "weights":[], "scalars":[]}
    
    # Convert PointIndices datatree to nested Python list and add to dict
    ConstraintSigs["pointIndices"] = [list(i) for i in PointIndices.Branches]
    
    # Add Scalars to dict if there are any
    if Scalars.DataCount:
        
        # Convert datatree to python list and ensure that length matches PointIndices
        scalars = [list(i) for i in Scalars.Branches]
        if len(scalars) != PointIndices.BranchCount:
            scalars = [list(Scalars.Branches[0]) for i in range(PointIndices.BranchCount)]
            
        # Case for point scalars datatree
        if isinstance(scalars[0][0],rc.Geometry.Point3d):
            for l in scalars:
                coords = []
                for pt in l:
                    coords.append(pt.X)
                    coords.append(pt.Y)
                    coords.append(pt.Z)
                ConstraintSigs["scalars"].append(coords)
                
        # Case for simple float datatree
        else:
            ConstraintSigs["scalars"] = scalars
            
    # Add weights to dict
    if len(Weights) != PointIndices.BranchCount:
        ConstraintSigs["weights"] = [Weights[0] for i in range(PointIndices.BranchCount)]
    else:
        ConstraintSigs["weights"] = Weights

    # Output to GH (wrap in list to send as one item)
    ConstraintSigs = [ConstraintSigs,]
    
else:
    ConstraintSigs = []
# ---------- end socsig ----------

list_4 = ValueList({"FaceVertices": "faceVertices", "VertexNeighbours": "vertexNeighbours", "EdgeVertices": "edgeVertices", "VerticesAll": "verticesAll", "VerticesEach": "verticesEach", "EdgeFaceVertices": "edgeFaceVertices", "FaceAngleVertices": "faceAngleVertices", "NakedVertices": "nakedVertices"}, selected="FaceVertices")
list_5 = ValueList({"SurfaceMaterial", "EdgeStrain", "TriangleStrain", "TetrahedronStrain", "Area", "Volume", "Bending", "Closeness", "Line", "Plane", "Circle", "Sphere", "Similarity", "Rigid", "Rectangle", "Parallelogram", "Laplacian", "LaplacianDisplacement", "Angle"}, selected="Area")
somi_2 = ShapeOpMeshIndexer(Pattern=list_4, Mesh=mesh_3)  # -> PointIndices; inputs Mesh: Mesh; same code as somi
merge_2 = Merge(Data1=Slider(1, range=0..2), Data2=Slider(1, range=0..2))
socsig_2 = ShapeOpConstraintSignature(ConstraintType=list_5, PointIndices=somi_2, Weights=Slider(5000, range=0..5000), Scalars=merge_2)  # -> ConstraintSigs; inputs PointIndices: tree of Int32, Weights: list, Scalars: tree; same code as socsig

list_6 = ValueList({"FaceVertices": "faceVertices", "VertexNeighbours": "vertexNeighbours", "EdgeVertices": "edgeVertices", "VerticesAll": "verticesAll", "VerticesEach": "verticesEach", "EdgeFaceVertices": "edgeFaceVertices", "FaceAngleVertices": "faceAngleVertices", "NakedVertices": "nakedVertices"}, selected="EdgeFaceVertices")
list_7 = ValueList({"SurfaceMaterial", "EdgeStrain", "TriangleStrain", "TetrahedronStrain", "Area", "Volume", "Bending", "Closeness", "Line", "Plane", "Circle", "Sphere", "Similarity", "Rigid", "Rectangle", "Parallelogram", "Laplacian", "LaplacianDisplacement", "Angle"}, selected="Bending")
somi_3 = ShapeOpMeshIndexer(Pattern=list_6, Mesh=mesh_3)  # -> PointIndices; inputs Mesh: Mesh; same code as somi
merge_3 = Merge(Data1=Slider(1, range=0..2), Data2=Slider(1, range=0..2))
socsig_3 = ShapeOpConstraintSignature(ConstraintType=list_7, PointIndices=somi_3, Weights=Slider(1, range=0..200), Scalars=merge_3)  # -> ConstraintSigs; inputs PointIndices: tree of Int32, Weights: list, Scalars: tree; same code as socsig

constraintsigs = Data(flatten([socsig_3, socsig_2, socsig]))

# ---- group: Output Data for Palabos-npFEM
list_8 = ValueList({"fileAddress": "DataTo_PLB_npFEM\"}, selected="fileAddress")
python_2 = PythonScript(ConstraintSigs=constraintsigs, fileAddress=list_8)  # inputs ConstraintSigs: list
# ---------- python_2: Python ----------
import Rhino as rc
import os

print fileAddress

if not os.path.exists(fileAddress):
    os.makedirs(fileAddress)

fileName = open(fileAddress+"constraints.csv", 'w')

for i,csd in enumerate(ConstraintSigs):
    for j in range(len(csd["pointIndices"])):
        string1 = str(csd["type"]) + ',' + ' '.join([str(k) for k in csd["pointIndices"][j]]) + ',' + str(csd["weights"][j])
        string2 = '\n'
        if csd["scalars"]:
            string2 = ',' + ' '.join([str(k) for k in csd["scalars"][j]]) + '\n'
        fileName.write(string1 + string2)
# ---------- end python_2 ----------
python_3 = PythonScript(points=demesh.Vertices, fileAddress=list_8)  # inputs points: list of Point3d
# ---------- python_3: Python ----------
import Rhino as rc
import os

print fileAddress

if not os.path.exists(fileAddress):
    os.makedirs(fileAddress)

fileName = open(fileAddress+"points.csv", 'w')
for pt in points:
    fileName.write(`pt.X` + ',' + `pt.Y` + ',' + `pt.Z` + '\n')

fileName.close()
# ---------- end python_3 ----------
python_4 = PythonScript(faces=demesh.Faces, fileAddress=list_8)  # inputs faces: list
# ---------- python_4: Python ----------
import Rhino as rc
import os

print fileAddress

if not os.path.exists(fileAddress):
    os.makedirs(fileAddress)

fileName = open(fileAddress+"surface_connectivity.csv", 'w')
for triangle in faces:
    fileName.write(`triangle[0]` + ',' + `triangle[1]` + ',' + `triangle[2]` + '\n')

fileName.close()
# ---------- end python_4 ----------

# ---- group: Solve (npFEM/ShapeOp)
steps_to_reach_steadystate = Slider(30, range=0..1500)
pause = BooleanToggle(False)
reset = BooleanToggle(True)

# ---- group: FEM solver parameters
max_line_search_loops = Slider(15, range=0..100000)
convergence_window = Slider(5, range=2..100)
volumeweight = Slider(250, range=0..1000000)
cbeta = Slider(1, range=-1000..1000000)
gamma2 = Slider(0.9, range=0..1)
tol = Slider(1e-06, range=0..1)
gamma = Slider(0.0001, range=0..1)
m = Slider(7, range=2..100)
shapeopsettingslive = ShapeOpSettingsLive(
    max_iterations=Slider(10000, range=1..100000),
    tol=tol,
    gamma=gamma,
    m=m,
    max_line_search_loops=max_line_search_loops,
    gamma2=gamma2,
    Calpha=Slider(0.5, range=0..1000000),
    Cbeta=cbeta,
    TimeStep=Slider(1000, range=0..1000),
    Pause=pause,
    Reset=reset,
    convergence_window=convergence_window,
    VolumeWeight=volumeweight)  # -> Settings; inputs max_iterations: Int32, Pause: Boolean, Reset: Boolean
#   port max_iterations: The number of iterations to run each time the component updates (default = 5)
# ---------- shapeopsettingslive: Python ----------
# Wrap all settings in a dict
Settings = [{
"VolumeWeight":VolumeWeight,
"convergence_window":int(convergence_window),
"max_iterations":int(max_iterations),
"tol":tol,
"gamma":gamma,
"max_line_search_loops":int(max_line_search_loops),
"m":int(m),
"gamma2":gamma2,
"Calpha":Calpha,
"Cbeta":Cbeta,
"timeStep":TimeStep,
"reset":Reset,
"pause":Pause
},]

print Settings
# ---------- end shapeopsettingslive ----------

# ---- group: Solve (npFEM/ShapeOp) (continued)
sosolver = ShapeOpConstraintSolver(
    ConstraintSigs=constraintsigs,
    Points=demesh.Vertices,
    Settings=shapeopsettingslive,
    F_plus=X,
    F_minus=X_2,
    ind_plus_axial=soai.PointIndices,
    ind_minus_axial=soai_2.PointIndices,
    steps_to_reach_steadyState=steps_to_reach_steadystate)  # -> Points; inputs ConstraintSigs: list, Points: list of Point3d, ind_plus_axial: list, ind_minus_axial: list
# ---------- sosolver: Python ----------
"""
This code is slightly modified by Palabos team, and adapted on the npFEM solver
"""
"""
Make a ShapeOp solver and solve a whole bunch of constraints!
-
Authors: Anders Holden Deleuran (CITA/KADK), Mario Deuss (LGG/EPFL) 
Github: github.com/AndersDeleuran/ShapeOpGHPython
Updated: 150402
    Args:
        ConstraintSigs: Signatures used for adding and editing constaints.
        Points: Points which the solver will operate on. ConstraintSigs should be constructed using the indices of this list.
        Settings: A list of settings which will be used to set up and run the solver..
    Returns:
        Iterations: The number of iterations the solver has run.
        ConstraintCount: The total number of contraints which are being solved.
        Points: The constrained points after solving.
"""

import Rhino as rc
import ctypes as ct
import Grasshopper as gh
from scriptcontext import sticky as st

# Load the compiled stand-alone library
so = ct.cdll.LoadLibrary("npFEM.dll")

# Set component name
ghenv.Component.Name = "ShapeOpConstraintSolver"
ghenv.Component.NickName = "SOSolver"

def makeSoSolver(points):
    
    """ Make ShapeOp solver and returns its ID and points coordinates ID """
    
    solver = so.shapeop_create()
    
    # Make ctypes double array containing points coordinates
    ptCoords = (ct.c_double * (len(points)*3))()
    for i in range(len(points)):
        b = 3*i
        ptCoords[b]   = float(points[i].X)
        ptCoords[b+1] = float(points[i].Y)
        ptCoords[b+2] = float(points[i].Z)
        
   # Add points coordinates to solver
    so.shapeop_setPoints(solver,ct.byref(ptCoords),len(points))
    
    return solver,ptCoords

def addSoConstraint(solver,constraintType,pointIndices,weight):
    
    """ Add a constraint: The solver is ID of shapeop solver, constraintType
    is name of constraint type to apply, pointIndices is list of points indices
    to operate on, weight is a float """
    
    t = ct.c_char_p(constraintType)
    ptIds = (ct.c_int * len(pointIndices))()
    for i,v in enumerate(pointIndices):
        ptIds[i] = v
        
    id = so.shapeop_addConstraint(solver,t,ct.byref(ptIds),len(pointIndices),weight)
    if id < 0 :
        raise LookupError("addSoConstraint failed adding a constraint of type "+constraintType)
    
    return id

def editSoConstraint(solver,constraintType,constraintId,scalars):
    
    """ Edit a constraint: solver is ID of shapeop solver, constraintType
    is name of constraint type to edit, constraintId is ID if the constraint.
    scalars is list of floats """
    
    t = ct.c_char_p(constraintType)
    scalarsC = (ct.c_double * len(scalars))()
    for i,s in enumerate(scalars):
        scalarsC[i] = s
        
    errCode = so.shapeop_editConstraint(solver,t,constraintId,ct.byref(scalarsC),len(scalars))
    if errCode != 0 :
        raise LookupError("editSoConstraint failed editing constraint. Check that SOGSig scalars are correctly defined.")

def addUnaryForce(solver,vector):
    
    """ Add a unary force to all points in the solver, only works dynamically """
    
    fv = (ct.c_double * 3)()
    fv[0] = float(vector.X)
    fv[1] = float(vector.Y)
    fv[2] = float(vector.Z)
    
    so.shapeop_addGravityForce(solver,fv)

def addVertexForce(solver):
    
    fv_plus = (ct.c_double * 3)()
    fv_plus[0] = float(F_plus.X/len(ind_plus_axial))
    fv_plus[1] = 0.
    fv_plus[2] = 0.
    
    fv_minus = (ct.c_double * 3)()
    fv_minus[0] = float(F_minus.X/len(ind_minus_axial))
    fv_minus[1] = 0.
    fv_minus[2] = 0.
    
    for i in ind_plus_axial:
        so.shapeop_addVertexForce(solver,fv_plus,i)
    for i in ind_minus_axial:
        so.shapeop_addVertexForce(solver,fv_minus,i)

def runSoSolverLive(ghenv,constraintSigs,points,settings):
    
    """ Run the ShapeOp solver cyclically (live) and return the points """
    
    # Get GH component guid and make unique variable names for sticky keys
    guid = str(ghenv.Component.InstanceGuid) + str(ghdoc.Path)
    solver = "solver_" + guid
    ptCoords = "vCoords_" + guid
    count = "count_" + guid
    editableCS = "editableCS" + guid
    csCount = "csCount_" + guid
    steps = "steps_"+guid
    
    if settings["reset"]:

        st[steps] = 0.
        
        # Delete old solver
        if solver in st:
            so.shapeop_delete(st[solver])
            
        # Make ShapeOp solver
        st[solver],st[ptCoords] = makeSoSolver(points)
        
        # Add constraints to the solver from the constraint signatures dictionary
        st[editableCS] = []
        st[csCount] = 0
        for i,csd in enumerate(constraintSigs):
            for j in range(len(csd["pointIndices"])):
                csid = addSoConstraint(st[solver],csd["type"],csd["pointIndices"][j],csd["weights"][j])
                st[csCount] += 1
                if csd["scalars"]:
                    editSoConstraint(st[solver],csd["type"],csid,csd["scalars"][j])
                    st[editableCS].append((i,j,csid))
        
        if F_plus:
            addVertexForce(st[solver])

        # Initialize solver
        err_code = 0
        err_code = so.shapeop_initDynamic(st[solver],ct.c_double(settings["Calpha"]),ct.c_double(settings["Cbeta"]),ct.c_double(settings["timeStep"]), ct.c_double(1125), 0, 1, ct.c_double(settings["VolumeWeight"]))
        if err_code != 0 :
            raise LookupError("ShapeOp init failed. Check that each point is constrained.")
        
        # Reset count
        st[count] = 0
        
        # Set component message
        ghenv.Component.Message = None
        
    else:
        
        # Update editable constraints
        for l in st[editableCS]:
            csdIndex,scalarsIndex,csid = l[0],l[1],l[2]
            scalars = constraintSigs[csdIndex]["scalars"]
            t = constraintSigs[csdIndex]["type"]
            editSoConstraint(st[solver],t,csid,scalars[scalarsIndex])
            
        # Solve and update the Grasshopper component (ie. update cyclically)
        err_code = so.shapeop_solve(st[solver],ct.c_int(settings["m"]),ct.c_int(settings["max_iterations"]),ct.c_int(settings["max_line_search_loops"]),ct.c_int(50), ct.c_int(settings["convergence_window"]),ct.c_double(settings["tol"]),ct.c_double(settings["gamma"]),ct.c_double(settings["gamma2"]))
        if err_code != 0 :
            raise LookupError("ShapeOp solve failed.")
        if (st[steps] == (steps_to_reach_steadyState-1)):
            settings["pause"] = True

        st[steps] += 1
        
        ghComponentTimer(ghenv,settings["pause"],10)
        
        # Set component message
        message = "Solver is Running Live"
        if settings["pause"]:
            message = "Solver is Paused"
        ghenv.Component.Message = message
        
    # Update and return the points list
    so.shapeop_getPoints(st[solver],ct.byref(st[ptCoords]),len(points))
    for i in range(len(points)):
        b = i*3
        points[i] = rc.Geometry.Point3d(st[ptCoords][b],st[ptCoords][b+1],st[ptCoords][b+2])
        
    return points

def ghComponentTimer(ghenv,pause,interval):
    
    """ Update the component at the interval like using a GH timer """
    
    # Ensure interval is larger than zero
    if interval <= 0:
        interval = 1
        
    # Get the Grasshopper document and component that owns this script
    ghComp = ghenv.Component
    ghDoc = ghComp.OnPingDocument()
    
    # Define the callback function
    def callBack(ghDoc):
        ghComp.ExpireSolution(False)
        
    # Update the solution
    if not pause:
        ghDoc.ScheduleSolution(interval,gh.Kernel.GH_Document.GH_ScheduleDelegate(callBack))

# Check GH input parameters
if ConstraintSigs and Points and Settings:
    
    # Run solver live (i.e. the solver component will cyclically update)
    Points = runSoSolverLive(ghenv,ConstraintSigs,Points,Settings)
# ---------- end sosolver ----------
conmesh = ConstructMesh(Vertices=sosolver, Faces=demesh.Faces)
mesh_4 = Mesh(conmesh)
